# Grasshopper definition ICD.ABM.DigitalFutures2022_Example_PanelAgents.gh (Grasshopper 1.0.7)
# plug-ins: ICD.ABM.DigitalFutures22.Grasshopper, ICD.AbmFramework.Grasshopper, Human

number_slider = Slider(1, range=0..1)
srf = Surface(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)
rails = Surface([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])
# © 2022 by ICD University of Stuttgart
isocurve = Curve(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)

# ---- group: Ascent
separation = CSharpScript(
    iStep=Slider(0.005, range=0..10),
    iFlip=Toggle(True),
    Reference=["C:\USERS\FABIAN\DESKTOP\ICD\ABMFIBERUNITY\ASSETS\SCRIPTS\ICD.AbmFramework.Core.dll", "C:\USERS\FABIAN\DESKTOP\ICD\PROJECTS\RP12\FILES\VS\ICD.ABM.DIGITALFUTURES22\ICD.ABM.DIGITALFUTURES22.CORE\BIN\DEBUG\NET45\ICD.ABM.DigitalFutures22.Core.dll"])  # -> out, oBehavior; inputs iStep: Double, iFlip: Boolean
# ---------- separation: C# usings ----------
using ICD.AbmFramework.Core;
using ICD.AbmFramework.Core.Agent;
using ICD.AbmFramework.Core.AgentSystem;
using ICD.AbmFramework.Core.Behavior;
using ICD.AbmFramework.Core.Environments;

using ICD.ABM.DigitalFutures22.Core.Agent;
using ICD.ABM.DigitalFutures22.Core.AgentSystem;
# ---------- separation: C# ----------
    behavior.Stepsize = iStep;
    behavior.Flip = iFlip;
    oBehavior = behavior;
# ---------- separation: C# additional code ----------
  DescentUVBehavior behavior = new DescentUVBehavior(1.0);

  public class DescentUVBehavior : BehaviorBase
  {
    public double Stepsize;
    public bool Flip;
    //public Vector3d derivatives[1];

    public DescentUVBehavior(double _stepsize)
    {
      Stepsize = _stepsize;
      Weight = 1.0;
    }

    public override void Execute(AgentBase agent)
    {
      PanelAgent myAgent = (PanelAgent) agent;
      PanelAgentSystem mySystem = (PanelAgentSystem) myAgent.AgentSystem;

      // get the slope at the current location
      Point3d currentPoint = mySystem.RailEnvironment.BrepObject.Surfaces[0].PointAt(myAgent.UV.X, myAgent.UV.Y);
      Vector3d upVector = Vector3d.ZAxis;

      double u, v = 0.0;
      mySystem.RailEnvironment.BrepObject.Surfaces[0].ClosestPoint(currentPoint + upVector, out u, out v);

      // Slope as ratio
      Point3d targetPoint = mySystem.RailEnvironment.BrepObject.Surfaces[0].PointAt(u, v);
      Vector3d targetVector = targetPoint - currentPoint;
      targetVector.Unitize();
      Vector3d targetVectorXY = new Vector3d(targetVector.X, targetVector.Y, 0);
      double slope = targetVector.Z / targetVectorXY.Length;

      //Slope as angle
      /*Vector3d normal = mySystem.SystemSurface.NormalAt(myAgent.UV.X, myAgent.UV.Y);
      double slope = Vector3d.VectorAngle(normal, Vector3d.ZAxis);*/

      if (Math.Abs(slope) < 0.0001)
      {
        myAgent.isFinished = true;
      }

      if(Flip)
        slope *= -1;

      Vector2d move2D = new Point2d(u, v) - myAgent.UV;
      move2D.Unitize();
      move2D *= slope * Stepsize;

      //make sure the agent stays within boundaries
      Point2d nextPostion = myAgent.UV + move2D;
      if(nextPostion.X < mySystem.RailEnvironment.BrepObject.Surfaces[0].Domain(0).Min || nextPostion.X > mySystem.RailEnvironment.BrepObject.Surfaces[0].Domain(0).Max)
      {
        myAgent.isFinished = true;
      } else if (nextPostion.Y < mySystem.RailEnvironment.BrepObject.Surfaces[0].Domain(1).Min || nextPostion.Y > mySystem.RailEnvironment.BrepObject.Surfaces[0].Domain(1).Max)
      {
        myAgent.isFinished = true;
      }

      myAgent.Moves.Add(move2D);
      myAgent.Weights.Add(Weight);
    }
  }
# ---------- end separation ----------

# ---- group: Umbilical
separation_2 = CSharpScript(
    iStep=Slider(0.01, range=0..10),
    iFlip=Toggle(False),
    Reference=["C:\USERS\FABIAN\DESKTOP\ICD\ABMFIBERUNITY\ASSETS\SCRIPTS\ICD.AbmFramework.Core.dll", "C:\USERS\FABIAN\DESKTOP\ICD\PROJECTS\RP12\FILES\VS\ICD.ABM.DIGITALFUTURES22\ICD.ABM.DIGITALFUTURES22.CORE\BIN\DEBUG\NET45\ICD.ABM.DigitalFutures22.Core.dll"])  # -> out, oBehavior; inputs iStep: Double, iFlip: Boolean
# ---------- separation_2: C# ----------
    behavior.Stepsize = iStep;
    behavior.Flip = iFlip;
    oBehavior = behavior;
# ---------- separation_2: C# additional code ----------
  DescentUVBehavior behavior = new DescentUVBehavior(1.0);

  public class DescentUVBehavior : BehaviorBase
  {
    public double Stepsize;
    public bool Flip;
    //public Vector3d derivatives[1];

    public DescentUVBehavior(double _stepsize)
    {
      Stepsize = _stepsize;
      Weight = 1.0;
    }

    public override void Execute(AgentBase agent)
    {
      UmbilicalAgent myAgent = (UmbilicalAgent) agent;
      UmbilicalAgentSystem mySystem = (UmbilicalAgentSystem) myAgent.AgentSystem;

      // get the curvature at the current location
      SurfaceCurvature curvature = mySystem.SystemSurface.CurvatureAt(myAgent.UV.X, myAgent.UV.Y);
      double uCurvature = curvature.Kappa(0);
      double vCurvature = curvature.Kappa(1);
      double delta = Math.Abs(uCurvature - vCurvature);
      double tol = 0.00001;
      if(delta < tol)
      {
        //Rhino.RhinoApp.WriteLine("Agent " + myAgent.Id + ": I've arrived at an umbilical point!");
        myAgent.isFinished = true;
        return;
      }

      // let's assume we're at a point where principal curvatures are different
      // question: which way do we have to go to reduce the difference between principal curvatures?
      // we know the principal curvature directions and the curvature amounts
      // approach: let's take a small step in the four directions of principal curvature and see if the delta
      // is reduced. Then go in the direction of the largest decrease

      Vector3d uDirection = curvature.Direction(0);
      uDirection.Unitize();
      Vector3d vDirection = curvature.Direction(1);
      vDirection.Unitize();

      double Factor = Stepsize * delta * 1000;

      Vector3d moveVectorUup = Factor * uDirection;
      Vector3d moveVectorUdown = moveVectorUup * -1;
      Vector3d moveVectorVup = Factor * vDirection;
      Vector3d moveVectorVdown = moveVectorVup * -1;

      List<Vector3d> testVectors = new List<Vector3d>{moveVectorUup, moveVectorUdown, moveVectorVup, moveVectorVdown};
      List<SurfaceCurvature> testCurvatures = new List<SurfaceCurvature>();
      List<double> testDeltas = new List<double>();

      foreach(Vector3d testVector in testVectors)
      {
        Point3d testPoint = curvature.Point + testVector;
        double uTest, vTest = 0.0;
        mySystem.SystemSurface.ClosestPoint(testPoint, out uTest, out vTest);
        SurfaceCurvature testCurvature = mySystem.SystemSurface.CurvatureAt(uTest, vTest);
        testCurvatures.Add(testCurvature);
        double uKappa = testCurvature.Kappa(0);
        double vKappa = testCurvature.Kappa(1);
        double testDelta = Math.Abs(Math.Abs(uKappa) - Math.Abs(vKappa));
        testDeltas.Add(testDelta);
      }

      //now find the min testDelta
      Double minDelta = testDeltas[0];
      int minIndex = 0;
      for(int i = 1; i < testDeltas.Count; i++)
      {
        if(testDeltas[i] < minDelta)
        {
          minDelta = testDeltas[i];
          minIndex = i;
        }
      }

      if(minDelta < delta)
      {
        //now choose the direction and curvature that will result in the largest decrease
        Vector3d targetDirection = testVectors[minIndex];
        SurfaceCurvature targetCurvature = testCurvatures[minIndex];

        //get the UV parameters at the target location
        Point2d targetUVPoint = targetCurvature.UVPoint;

        Vector2d move2D = targetUVPoint - myAgent.UV;
        move2D.Unitize();
        move2D *= Factor;

        myAgent.Moves.Add(move2D);
        myAgent.Weights.Add(Weight);
      }
    }
  }
# ---------- end separation_2 ----------

# ---- group: Random walk
separation_3 = CSharpScript(
    iStep=Slider(20, range=0..20),
    Reference=["C:\USERS\FABIAN\DESKTOP\ICD\ABMFIBERUNITY\ASSETS\SCRIPTS\ICD.AbmFramework.Core.dll", "C:\USERS\FABIAN\DESKTOP\ICD\PROJECTS\RP12\FILES\VS\ICD.ABM.DIGITALFUTURES22\ICD.ABM.DIGITALFUTURES22.CORE\BIN\DEBUG\NET45\ICD.ABM.DigitalFutures22.Core.dll"])  # -> out, oBehavior; inputs iStep: Double
# ---------- separation_3: C# ----------
    behavior.Stepsize = iStep;
    oBehavior = behavior;
# ---------- separation_3: C# additional code ----------
  WanderingUVBehavior behavior = new WanderingUVBehavior(1.0);

  public class WanderingUVBehavior : BehaviorBase
  {
    public double Stepsize;
    Random rand = new Random();

    public WanderingUVBehavior(double _stepsize)
    {
      Stepsize = _stepsize;
      Weight = 1.0;
    }

    public override void Execute(AgentBase agent)
    {
      PanelAgent myAgent = (PanelAgent) agent;
      PanelAgentSystem mySystem = (PanelAgentSystem) myAgent.AgentSystem;

      Vector2d moveVector = Vector2d.Zero;

      moveVector.X = rand.NextDouble() - 0.5;
      moveVector.Y = rand.NextDouble() - 0.5;

      moveVector.Unitize();

      moveVector *= Stepsize;

      //make sure the agent stays within boundaries
      Point2d nextPostion = myAgent.UV + moveVector;
      if(nextPostion.X < mySystem.RailEnvironment.BrepObject.Surfaces[0].Domain(0).Min || nextPostion.X > mySystem.RailEnvironment.BrepObject.Surfaces[0].Domain(0).Max)
      {
        moveVector.X *= -1;
      } else if (nextPostion.Y < mySystem.RailEnvironment.BrepObject.Surfaces[0].Domain(1).Min || nextPostion.Y > mySystem.RailEnvironment.BrepObject.Surfaces[0].Domain(1).Max)
      {
        moveVector.Y *= -1;
      }

      myAgent.Moves.Add(moveVector);
      myAgent.Weights.Add(Weight);
    }
  }
# ---------- end separation_3 ----------

# ----
popgeo = PopulateGeometry(Geometry=srf, Count=Slider(9, range=2..50), Seed=1)
preview = CustomPreview(
    Geometry=isocurve,
    Material={diffuse=RGB(221, 160, 221), emission=RGB(66, 48, 66), shine=0.5, specular=RGB(255, 255, 255), transparency=0})
panelagent = GhcDefinePanelAgent(UVPosition=popgeo, Behaviors=[separation.oBehavior, separation_3.oBehavior])
ghcdefinerailenvironment = GhcDefineRailEnvironment(SingleBrep=srf, RailCurves=isocurve, RailSurfaces=rails, Spacing=10)
panelagentsystem = GhcDefinePanelAgentSystem(RailEnvironment=ghcdefinerailenvironment, PanelAgents=panelagent)
solver = StepByStepSolver(Reset=Button(), Execute=Toggle(False), AgentSystems=panelagentsystem)  # -> DisplayGeometries, AllAgentSystems, IterationCount
panel = Panel(solver.IterationCount)
vispanelas = GhcVisPanelAS(PanelAgentSystem=solver.AllAgentSystems, DisplayOnly=Toggle(False))  # -> AgentFrames, CellPolylines, Mesh, NeighborsOnRail, PanelCuts, Cutplanes
pt = Point(vispanelas.AgentFrames)
crv = Curve(vispanelas.CellPolylines)
mesh = Mesh(vispanelas.Mesh)
crv_2 = Curve(vispanelas.NeighborsOnRail)
crv_3 = Curve(vispanelas.PanelCuts)
pln = Plane(vispanelas.Cutplanes)
item = ListItem(List=crv, Index=Slider(0, range=0..50), Wrap=True)
previewlw = CustomPreviewLineweights(Geometry=crv_3, Shader=ColourSwatch(SwatchColor=RGB(0, 195, 255)), Thickness=Slider(5, range=0..10), Absolute=False)
