# Grasshopper definition Umbilical_system-Design-delta_surface.gh (Grasshopper 1.0.7)
# plug-ins: ABxM.Grasshopper, Pufferfish

list = ValueList({"Test surface": 0, "Design surface 220610": 1, "Design surface 220617": 2, "Laga surface": 3, "Other design surface": 4}, selected="Other design surface")
pt = Point(Point(73323.50808, -16184.80895, 0))
pt_2 = Point(Point(2104.718884, 75.3038713, 0))
pt_3 = Point(Point(23763.02259, 1245.000547, 0))

# ---- group: Design surface
srf = Surface(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)

# ----
pt_4 = Point(Point(56043.35819, -16285.51294, 0))

# ---- group: Design surface
srf_2 = Surface(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)

# ---- group: Test surface
srf_3 = Surface(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)

# ----
pt_5 = Point(Point(56043.35819, -16285.51294, 0))

# ---- group: Design surface 220617
srf_4 = Surface(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)

# ---- group: Design surface 220610
srf_5 = Surface(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)

# ----
filter = StreamFilter(Gate=list, Stream0=srf_3, Stream1=srf_5, Stream2=srf_4, Stream3=srf_2, Stream4=srf)
filter_2 = StreamFilter(Gate=list, Stream0=pt_2, Stream1=pt_5, Stream2=pt_4, Stream3=pt_3, Stream4=pt)
shrinktrimsrf = ShrinkTrimmedSurface(Surface=filter)  # -> Shrunken, Underlying, R
srf_6 = Surface(shrinktrimsrf.Underlying)
pt_6 = Point(filter_2)
xy = XYPlane(Origin=pt_6)

# ----
# Set the resolution of the analysis grid
dedom2 = DeconstructDomain²(Domain=srf_6)  # -> UComponent, VComponent
num = Number(dedom2.UComponent)
num_2 = Number(dedom2.VComponent)
eval = Evaluate(F="Floor(x/y)", x=num, y="100")
eval_2 = Evaluate(F="Floor(x/y)", x=num_2, y="100")
range = Range(Domain=dedom2.UComponent, Steps=eval)
range_2 = Range(Domain=dedom2.VComponent, Steps=eval_2)
pt_7 = ConstructPoint(XCoordinate=range, YCoordinate=graft(range_2), ZCoordinate=0)

planesrf = PlaneSurface(Plane=xy, XSize=dedom2.UComponent, YSize=dedom2.VComponent)
md_slider = MDSlider(
    SliderMode=0,
    slider_value=Point(0.6675240121, 0.3877683035, 0.5),
    x_domain=Domain(0, 1),
    y_domain=Domain(0, 1),
    z_domain=Domain(0, 1))
orient = Orient(Geometry=pt_7, Source=PlaneXY(0, 0, 0), Target=xy)  # -> Geometry, Transform
c_script = CSharpScript(iSurf=srf_6, iUV=pt_7)  # -> out, A, B; inputs iSurf: Surface, iUV: Point3d
# ---------- c_script: C# ----------
    SurfaceCurvature curvature = iSurf.CurvatureAt(iUV.X, iUV.Y);
    double uCurvature = curvature.Kappa(0);
    double vCurvature = curvature.Kappa(1);
    if(uCurvature > 0 && vCurvature > 0)
    {
      //The surface is convex
    } else if (uCurvature < 0 && vCurvature < 0){
      //The surface is concave
    } else {
      // the surface is saddle-shaped
    }
    double delta = Math.Abs(uCurvature - vCurvature);
    //double delta = uCurvature - vCurvature;
    Point3d point = curvature.Point;


    A = point;
    B = delta;
# ---------- end c_script ----------
iso = IsoCurve(Surface=reparameterize(srf_6), UVPoint=md_slider)  # -> UIsocurve, VIsocurve
iso_2 = IsoCurve(Surface=reparameterize(planesrf), UVPoint=md_slider)  # -> UIsocurve, VIsocurve
c_script_2 = CSharpScript(iSurf=srf_6, iUV=md_slider)  # -> out, A, B; inputs iSurf: Surface, iUV: Point3d
# ---------- c_script_2: C# ----------
    Vector3d[] derivatives;
    Point3d point = Point3d.Unset;
    iSurf.Evaluate(iUV.X, iUV.Y, 1, out point, out derivatives);

    for (int i = 0; i < derivatives.Length; i++)
    {
      derivatives[i].Unitize();
    }

    A = point;
    B = derivatives[1];
# ---------- end c_script_2 ----------
c_script_3 = CSharpScript(iSurf=srf_6, iUV=md_slider)  # -> out, A, B; inputs iSurf: Surface, iUV: Point3d
# ---------- c_script_3: C# ----------
    SurfaceCurvature curvature = iSurf.CurvatureAt(iUV.X, iUV.Y);
    Vector3d maxDir = curvature.Direction(0);
    Point3d point = curvature.Point;


    A = point;
    B = maxDir;
# ---------- end c_script_3 ----------
panel = Panel(c_script.B)
bnd = Bounds(Numbers=flatten(c_script.B))
crv = Curve(iso.VIsocurve)
crv_2 = Curve(iso_2.VIsocurve)
amp = Amplitude(Vector=c_script_3.B, Amplitude=Slider(100, range=0..100))
pdecon = Deconstruct(Point=orient.Geometry)  # -> XComponent, YComponent, ZComponent
remap = RemapNumbers(Value=c_script.B, Source=bnd, Target="5000")  # -> Mapped, Clipped
int = Integer("5000")
vdis = VectorDisplay(Anchor=c_script_3.A, Vector=amp)
pt_8 = ConstructPoint(XCoordinate=pdecon.XComponent, YCoordinate=pdecon.YComponent, ZCoordinate=remap.Mapped)  # -> simplify(Point)
bnd_2 = Bounds(Numbers=flatten(remap.Mapped))
tstat = TreeStatistics(Tree=pt_8)  # -> Paths, Length, Count
branch = TreeBranch(Tree=pt_8, Path="{0}", MaintainPaths=True)
lng = ListLength(List=branch)
points = PointList(Points=flatten(pt_8))
panel_2 = Panel("20")
srfgrid = SurfaceFromPoints(Points=flatten(pt_8), UCount=tstat.Count, Interpolate=False)  # -> reparameterize(Surface)
mesh = MeshBrep(
    Brep=srfgrid,
    Settings={GridMaxCount=0, GridMinCount=16, JaggedSeams=False, MaxEdgeLength=0, MinEdgeLength=0.0001, MinTolerance=0, Refine=True, RefineAngle=0, RelativeTolerance=0.65, SimplePlanes=True, Tolerance=0})
demesh = DeconstructMesh(Mesh=mesh)  # -> Vertices, Faces, Colours, Normals
number_slider = Slider(0.01, range=0..10)
eval_3 = Evaluate(F="-x * 8/5", x=int)
toggle = BooleanToggle(False)
popgeo = PopulateGeometry(Geometry=srfgrid, Count=Slider(10, range=0..10), Seed=1)
pdecon_2 = Deconstruct(Point=demesh.Vertices)  # -> XComponent, YComponent, ZComponent
dom = ConstructDomain(DomainStart=eval_3, DomainEnd=int)

# ---- group: Random walk
separation = CSharpScript(
    iStep=Slider(0.02, range=0..1),
    Reference=["C:\Users\Tobias Schwinn\AppData\Roaming\Grasshopper\Libraries\ICD.ABM.DigitalFutures22.Core.dll", "C:\Users\Tobias Schwinn\AppData\Roaming\Grasshopper\Libraries\ABxM.Core.dll"])  # -> out, oBehavior; inputs iStep: Double
# ---------- separation: C# usings ----------
using ABxM.Core;
using ABxM.Core.Agent;
using ABxM.Core.AgentSystem;
using ABxM.Core.Behavior;
using ABxM.Core.Environments;

using ICD.ABM.DigitalFutures22.Core.Agent;
using ICD.ABM.DigitalFutures22.Core.AgentSystem;
# ---------- separation: C# ----------
    behavior.Stepsize = iStep;
    oBehavior = behavior;
# ---------- separation: C# additional code ----------
  WanderingUVBehavior behavior = new WanderingUVBehavior(1.0);

  public class WanderingUVBehavior : BehaviorBase
  {
    public double Stepsize;
    Random rand = new Random();

    public WanderingUVBehavior(double _stepsize)
    {
      Stepsize = _stepsize;
      Weight = 1.0;
    }

    public override void Execute(AgentBase agent)
    {
      UmbilicalAgent myAgent = (UmbilicalAgent) agent;
      UmbilicalAgentSystem mySystem = (UmbilicalAgentSystem) myAgent.AgentSystem;

      Vector2d moveVector = Vector2d.Zero;

      moveVector.X = rand.NextDouble() - 0.5;
      moveVector.Y = rand.NextDouble() - 0.5;

      moveVector.Unitize();

      moveVector *= Stepsize;

      //make sure the agent stays within boundaries
      Point2d nextPostion = myAgent.UV + moveVector;
      if(nextPostion.X < mySystem.SystemSurface.Domain(0).Min || nextPostion.X > mySystem.SystemSurface.Domain(0).Max)
      {
        moveVector.X *= -1;
      } else if (nextPostion.Y < mySystem.SystemSurface.Domain(1).Min || nextPostion.Y > mySystem.SystemSurface.Domain(1).Max)
      {
        moveVector.Y *= -1;
      }

      myAgent.Moves.Add(moveVector);
      myAgent.Weights.Add(Weight);
    }
  }
# ---------- end separation ----------

# ---- group: Descent
separation_2 = CSharpScript(
    iStep=Slider(0.005, range=0..10),
    iFlip=Toggle(True),
    Reference=["C:\Users\Tobias Schwinn\AppData\Roaming\Grasshopper\Libraries\ICD.ABM.DigitalFutures22.Core.dll", "C:\Users\Tobias Schwinn\AppData\Roaming\Grasshopper\Libraries\ABxM.Core.dll"])  # -> out, oBehavior; inputs iStep: Double, iFlip: Boolean
# ---------- separation_2: C# ----------
    behavior.Stepsize = iStep;
    behavior.Flip = iFlip;
    oBehavior = behavior;
# ---------- separation_2: C# additional code ----------
  DescentUVBehavior behavior = new DescentUVBehavior(1.0);

  public class DescentUVBehavior : BehaviorBase
  {
    public double Stepsize;
    public bool Flip;
    //public Vector3d derivatives[1];

    public DescentUVBehavior(double _stepsize)
    {
      Stepsize = _stepsize;
      Weight = 1.0;
    }

    public override void Execute(AgentBase agent)
    {
      UmbilicalAgent myAgent = (UmbilicalAgent) agent;
      UmbilicalAgentSystem mySystem = (UmbilicalAgentSystem) myAgent.AgentSystem;

      // get the slope at the current location
      Point3d currentPoint = mySystem.SystemSurface.PointAt(myAgent.UV.X, myAgent.UV.Y);
      Vector3d upVector = Vector3d.ZAxis;

      double u, v = 0.0;
      mySystem.SystemSurface.ClosestPoint(currentPoint + upVector, out u, out v);

      // Slope as ratio
      Point3d targetPoint = mySystem.SystemSurface.PointAt(u, v);
      Vector3d targetVector = targetPoint - currentPoint;
      targetVector.Unitize();
      Vector3d targetVectorXY = new Vector3d(targetVector.X, targetVector.Y, 0);
      double slope = targetVector.Z / targetVectorXY.Length;

      //Slope as angle
      /*Vector3d normal = mySystem.SystemSurface.NormalAt(myAgent.UV.X, myAgent.UV.Y);
      double slope = Vector3d.VectorAngle(normal, Vector3d.ZAxis);*/

      if (Math.Abs(slope) < 0.0001)
      {
        myAgent.isFinished = true;
      }

      if(Flip)
        slope *= -1;

      Vector2d move2D = new Point2d(u, v) - myAgent.UV;
      move2D.Unitize();
      move2D *= slope * Stepsize;

      //make sure the agent stays within boundaries
      Point2d nextPostion = myAgent.UV + move2D;
      if(nextPostion.X < mySystem.SystemSurface.Domain(0).Min || nextPostion.X > mySystem.SystemSurface.Domain(0).Max)
      {
        myAgent.isFinished = true;
      } else if (nextPostion.Y < mySystem.SystemSurface.Domain(1).Min || nextPostion.Y > mySystem.SystemSurface.Domain(1).Max)
      {
        myAgent.isFinished = true;
      }

      myAgent.Moves.Add(move2D);
      myAgent.Weights.Add(Weight);
    }
  }
# ---------- end separation_2 ----------

# ---- group: Umbilical
separation_3 = CSharpScript(
    iStep=number_slider,
    iFlip=toggle,
    Reference=["C:\Users\Tobias Schwinn\AppData\Roaming\Grasshopper\Libraries\ICD.ABM.DigitalFutures22.Core.dll", "C:\Users\Tobias Schwinn\AppData\Roaming\Grasshopper\Libraries\ABxM.Core.dll"])  # -> out, oBehavior; inputs iStep: Double, iFlip: Boolean
# ---------- separation_3: C# ----------
    behavior.Stepsize = iStep;
    behavior.Flip = iFlip;
    oBehavior = behavior;
# ---------- separation_3: C# additional code ----------
  DescentUVBehavior behavior = new DescentUVBehavior(1.0);

  public class DescentUVBehavior : BehaviorBase
  {
    public double Stepsize;
    public bool Flip;
    //public Vector3d derivatives[1];

    public DescentUVBehavior(double _stepsize)
    {
      Stepsize = _stepsize;
      Weight = 1.0;
    }

    public override void Execute(AgentBase agent)
    {
      UmbilicalAgent myAgent = (UmbilicalAgent) agent;
      UmbilicalAgentSystem mySystem = (UmbilicalAgentSystem) myAgent.AgentSystem;

      // get the curvature at the current location
      SurfaceCurvature curvature = mySystem.SystemSurface.CurvatureAt(myAgent.UV.X, myAgent.UV.Y);
      double uCurvature = curvature.Kappa(0);
      double vCurvature = curvature.Kappa(1);
      double delta = Math.Abs(uCurvature - vCurvature);
      double tol = 0.00001;
      if(delta < tol)
      {
        //Rhino.RhinoApp.WriteLine("Agent " + myAgent.Id + ": I've arrived at an umbilical point!");
        myAgent.isFinished = true;
        return;
      }

      // let's assume we're at a point where principal curvatures are different
      // question: which way do we have to go to reduce the difference between principal curvatures?
      // we know the principal curvature directions and the curvature amounts
      // approach: let's take a small step in the four directions of principal curvature and see if the delta
      // is reduced. Then go in the direction of the largest decrease

      Vector3d uDirection = curvature.Direction(0);
      uDirection.Unitize();
      Vector3d vDirection = curvature.Direction(1);
      vDirection.Unitize();

      double Factor = Stepsize * delta * 1000;

      Vector3d moveVectorUup = Factor * uDirection;
      Vector3d moveVectorUdown = moveVectorUup * -1;
      Vector3d moveVectorVup = Factor * vDirection;
      Vector3d moveVectorVdown = moveVectorVup * -1;

      List<Vector3d> testVectors = new List<Vector3d>{moveVectorUup, moveVectorUdown, moveVectorVup, moveVectorVdown};
      List<SurfaceCurvature> testCurvatures = new List<SurfaceCurvature>();
      List<double> testDeltas = new List<double>();

      foreach(Vector3d testVector in testVectors)
      {
        Point3d testPoint = curvature.Point + testVector;
        double uTest, vTest = 0.0;
        mySystem.SystemSurface.ClosestPoint(testPoint, out uTest, out vTest);
        SurfaceCurvature testCurvature = mySystem.SystemSurface.CurvatureAt(uTest, vTest);
        testCurvatures.Add(testCurvature);
        double uKappa = testCurvature.Kappa(0);
        double vKappa = testCurvature.Kappa(1);
        double testDelta = Math.Abs(Math.Abs(uKappa) - Math.Abs(vKappa));
        testDeltas.Add(testDelta);
      }

      //now find the min testDelta
      Double minDelta = testDeltas[0];
      int minIndex = 0;
      for(int i = 1; i < testDeltas.Count; i++)
      {
        if(testDeltas[i] < minDelta)
        {
          minDelta = testDeltas[i];
          minIndex = i;
        }
      }

      if(minDelta < delta)
      {
        //now choose the direction and curvature that will result in the largest decrease
        Vector3d targetDirection = testVectors[minIndex];
        SurfaceCurvature targetCurvature = testCurvatures[minIndex];

        //get the UV parameters at the target location
        Point2d targetUVPoint = targetCurvature.UVPoint;

        Vector2d move2D = targetUVPoint - myAgent.UV;
        move2D.Unitize();
        move2D *= Factor;

        myAgent.Moves.Add(move2D);
        myAgent.Weights.Add(Weight);
      }
    }
  }
# ---------- end separation_3 ----------

# ----
separation_4 = CSharpScript(
    iStep=number_slider,
    iFlip=toggle,
    Reference=["C:\USERS\TOBIAS SCHWINN\APPDATA\ROAMING\GRASSHOPPER\LIBRARIES\ICD.AbmFramework.Core.dll", "C:\Users\Tobias Schwinn\AppData\Roaming\Grasshopper\Libraries\ICD.ABM.DigitalFutures22.Core.dll"])  # -> out, oBehavior; inputs iStep: Double, iFlip: Boolean; disabled
# ---------- separation_4: C# usings ----------
using ICD.AbmFramework.Core;
using ICD.AbmFramework.Core.Agent;
using ICD.AbmFramework.Core.AgentSystem;
using ICD.AbmFramework.Core.Behavior;
using ICD.AbmFramework.Core.Environments;

using ICD.ABM.DigitalFutures22.Core.Agent;
using ICD.ABM.DigitalFutures22.Core.AgentSystem;
# ---------- separation_4: C# ----------
    behavior.Stepsize = iStep;
    behavior.Flip = iFlip;
    oBehavior = behavior;
# ---------- separation_4: C# additional code ----------
  DescentUVBehavior behavior = new DescentUVBehavior(1.0);

  public class DescentUVBehavior : BehaviorBase
  {
    public double Stepsize;
    public bool Flip;
    //public Vector3d derivatives[1];

    public DescentUVBehavior(double _stepsize)
    {
      Stepsize = _stepsize;
      Weight = 1.0;
    }

    public override void Execute(AgentBase agent)
    {
      UmbilicalAgent myAgent = (UmbilicalAgent) agent;
      UmbilicalAgentSystem mySystem = (UmbilicalAgentSystem) myAgent.AgentSystem;

      // get the curvature at the current location
      SurfaceCurvature curvature = mySystem.SystemSurface.CurvatureAt(myAgent.UV.X, myAgent.UV.Y);
      double uCurvature = curvature.Kappa(0);
      double vCurvature = curvature.Kappa(1);
      double delta = Math.Abs(uCurvature - vCurvature);
      double tol = 0.00001;
      if(delta < tol)
      {
        //Rhino.RhinoApp.WriteLine("Agent " + myAgent.Id + ": I've arrived at an umbilical point!");
        myAgent.isFinished = true;
        return;
      }

      // let's assume we're at a point where principal curvatures are different
      // question: which way do we have to go to reduce the difference between principal curvatures?
      // we know the principal curvature directions and the curvature amounts
      // approach: let's take a small step in the four directions of principal curvature and see if the delta
      // is reduced. Then go in the direction of the largest decrease

      Vector3d uDirection = curvature.Direction(0);
      uDirection.Unitize();
      Vector3d vDirection = curvature.Direction(1);
      vDirection.Unitize();

      double Factor = Stepsize * delta * 1000;

      Vector3d moveVectorUup = Factor * uDirection;
      Vector3d moveVectorUdown = moveVectorUup * -1;
      Vector3d moveVectorVup = Factor * vDirection;
      Vector3d moveVectorVdown = moveVectorVup * -1;

      List<Vector3d> testUVectors = new List<Vector3d>{moveVectorUup, moveVectorUdown};
      List<SurfaceCurvature> testUCurvatures = new List<SurfaceCurvature>();
      List<double> testUDeltas = new List<double>();

      foreach(Vector3d testVector in testUVectors)
      {
        Point3d testPoint = curvature.Point + testVector;
        double uTest, vTest = 0.0;
        mySystem.SystemSurface.ClosestPoint(testPoint, out uTest, out vTest);
        SurfaceCurvature testCurvature = mySystem.SystemSurface.CurvatureAt(uTest, vTest);
        testUCurvatures.Add(testCurvature);
        double uKappa = testCurvature.Kappa(0);
        double vKappa = testCurvature.Kappa(1);
        double testDelta = Math.Abs(Math.Abs(uKappa) - Math.Abs(vKappa));
        testUDeltas.Add(testDelta);
      }

      List<Vector3d> testVVectors = new List<Vector3d>{moveVectorVup, moveVectorVdown};
      List<SurfaceCurvature> testVCurvatures = new List<SurfaceCurvature>();
      List<double> testVDeltas = new List<double>();

      foreach(Vector3d testVector in testVVectors)
      {
        Point3d testPoint = curvature.Point + testVector;
        double uTest, vTest = 0.0;
        mySystem.SystemSurface.ClosestPoint(testPoint, out uTest, out vTest);
        SurfaceCurvature testCurvature = mySystem.SystemSurface.CurvatureAt(uTest, vTest);
        testVCurvatures.Add(testCurvature);
        double uKappa = testCurvature.Kappa(0);
        double vKappa = testCurvature.Kappa(1);
        double testDelta = Math.Abs(Math.Abs(uKappa) - Math.Abs(vKappa));
        testVDeltas.Add(testDelta);
      }

      //now find the min in testUDeltas
      Double minUDelta = testUDeltas[0];
      int minUIndex = 0;
      if (testUDeltas[1] < testUDeltas[0])
      {
        minUDelta = testUDeltas[1];
        minUIndex = 1;
      }

      //now find the min in testVDeltas
      Double minVDelta = testVDeltas[0];
      int minVIndex = 0;
      if (testVDeltas[1] < testVDeltas[0])
      {
        minVDelta = testVDeltas[1];
        minVIndex = 1;
      }

      //now choose the direction and curvature that will result in the largest decrease
      SurfaceCurvature targetCurvatureU = testUCurvatures[minUIndex];
      SurfaceCurvature targetCurvatureV = testVCurvatures[minVIndex];

      //get the UV parameters at the target location
      Point2d targetUVPointU = targetCurvatureU.UVPoint;
      Point2d targetUVPointV = targetCurvatureU.UVPoint;

      Vector2d move2DU = targetUVPointU - myAgent.UV;
      move2DU.Unitize();
      move2DU *= Factor;
      myAgent.Moves.Add(move2DU);
      myAgent.Weights.Add(Weight);

      Vector2d move2DV = targetUVPointV - myAgent.UV;
      move2DV.Unitize();
      move2DV *= Factor;
      myAgent.Moves.Add(move2DV);
      myAgent.Weights.Add(Weight);

    }
  }
# ---------- end separation_4 ----------
separation_5 = CSharpScript(
    iStep=number_slider,
    iFlip=toggle,
    Reference=["C:\USERS\TOBIAS SCHWINN\APPDATA\ROAMING\GRASSHOPPER\LIBRARIES\ICD.AbmFramework.Core.dll", "C:\Users\Tobias Schwinn\AppData\Roaming\Grasshopper\Libraries\ICD.ABM.DigitalFutures22.Core.dll"])  # -> out, oBehavior; inputs iStep: Double, iFlip: Boolean; disabled
# ---------- separation_5: C# ----------
    behavior.Stepsize = iStep;
    behavior.Flip = iFlip;
    oBehavior = behavior;
# ---------- separation_5: C# additional code ----------
  DescentUVBehavior behavior = new DescentUVBehavior(1.0);

  public class DescentUVBehavior : BehaviorBase
  {
    public double Stepsize;
    public bool Flip;
    //public Vector3d derivatives[1];

    public DescentUVBehavior(double _stepsize)
    {
      Stepsize = _stepsize;
      Weight = 1.0;
    }

    public override void Execute(AgentBase agent)
    {
      UmbilicalAgent myAgent = (UmbilicalAgent) agent;
      UmbilicalAgentSystem mySystem = (UmbilicalAgentSystem) myAgent.AgentSystem;

      // get the curvature at the current location
      SurfaceCurvature curvature = mySystem.SystemSurface.CurvatureAt(myAgent.UV.X, myAgent.UV.Y);
      double uCurvature = curvature.Kappa(0);
      double vCurvature = curvature.Kappa(1);
      double delta = Math.Abs(uCurvature - vCurvature);
      double tol = 0.00001;
      if(delta < tol)
      {
        //Rhino.RhinoApp.WriteLine("Agent " + myAgent.Id + ": I've arrived at an umbilical point!");
        myAgent.isFinished = true;
        return;
      }

      // let's assume we're at a point where principal curvatures are different
      // question: which way do we have to go to reduce the difference between principal curvatures?
      // we know the principal curvature directions and the curvature amounts
      // approach: let's take a small step in the four directions of principal curvature and see if the delta
      // is reduced. Then go in the direction of the largest decrease

      Vector3d uDirection = curvature.Direction(0);
      uDirection.Unitize();
      Vector3d vDirection = curvature.Direction(1);
      vDirection.Unitize();

      double Factor = Stepsize * delta * 100;

      Point3d origin = curvature.Point;
      Vector3d normal = curvature.Normal;
      Plane frame = new Plane(origin, normal);
      Circle circle = new Circle(frame, Factor);
      List<Vector3d> testVectors = new List<Vector3d>();

      int numDivisions = 8;
      for(int i = 0; i < numDivisions; i++)
      {
        Point3d divisionPoint = circle.PointAt(i / numDivisions);
        testVectors.Add(divisionPoint - origin);
      }

      List<SurfaceCurvature> testCurvatures = new List<SurfaceCurvature>();
      List<double> testDeltas = new List<double>();

      foreach(Vector3d testVector in testVectors)
      {
        Point3d testPoint = curvature.Point + testVector;
        double uTest, vTest = 0.0;
        mySystem.SystemSurface.ClosestPoint(testPoint, out uTest, out vTest);
        SurfaceCurvature testCurvature = mySystem.SystemSurface.CurvatureAt(uTest, vTest);
        testCurvatures.Add(testCurvature);
        double uKappa = testCurvature.Kappa(0);
        double vKappa = testCurvature.Kappa(1);
        double testDelta = Math.Abs(Math.Abs(uKappa) - Math.Abs(vKappa));
        testDeltas.Add(testDelta);
      }

      //now find the min testDelta
      Double minDelta = testDeltas[0];
      int minIndex = 0;
      for(int i = 1; i < testDeltas.Count; i++)
      {
        if(testDeltas[i] < minDelta)
        {
          minDelta = testDeltas[i];
          minIndex = i;
        }
      }

      if(minDelta < delta)
      {
        //now choose the direction and curvature that will result in the largest decrease
        Vector3d targetDirection = testVectors[minIndex];
        SurfaceCurvature targetCurvature = testCurvatures[minIndex];

        //get the UV parameters at the target location
        Point2d targetUVPoint = targetCurvature.UVPoint;

        Vector2d move2D = targetUVPoint - myAgent.UV;
        move2D.Unitize();
        move2D *= Factor;

        myAgent.Moves.Add(move2D);
        myAgent.Weights.Add(Weight);
      }
    }
  }
# ---------- end separation_5 ----------
srf_cp = SurfaceClosestPoint(Point=popgeo, Surface=srfgrid)  # -> Point, UVPoint, Distance
remap_2 = RemapNumbers(Value=pdecon_2.ZComponent, Source=dom, Target=Domain(0, 1))  # -> Mapped, Clipped
c_script_4 = CSharpScript(
    initialUV=srf_cp.UVPoint,
    iBehaviors=separation_2.oBehavior,
    Reference=["C:\Users\Tobias Schwinn\AppData\Roaming\Grasshopper\Libraries\ICD.ABM.DigitalFutures22.Core.dll", "C:\Users\Tobias Schwinn\AppData\Roaming\Grasshopper\Libraries\ABxM.Core.dll"])  # -> out, oAgent; inputs initialUV: Point3d, iBehaviors: list
# ---------- c_script_4: C# usings ----------
using System.IO;
using System.Linq;
using System.Data;
using System.Drawing;
using System.Reflection;
using System.Windows.Forms;
using System.Xml;
using System.Xml.Linq;
using System.Runtime.InteropServices;

using Rhino.DocObjects;
using Rhino.Collections;
using GH_IO;
using GH_IO.Serialization;

using ABxM.Core;
using ABxM.Core.Agent;
using ABxM.Core.AgentSystem;
using ABxM.Core.Behavior;
using ABxM.Core.Environments;

using ICD.ABM.DigitalFutures22.Core.Agent;
using ICD.ABM.DigitalFutures22.Core.AgentSystem;
# ---------- c_script_4: C# ----------
    //if (iAgents.Count != iIndices.Count)
    //  throw new ArgumentException("Lists of agents and indices must be the same size!");

    List<BehaviorBase> behaviors = new List<BehaviorBase>();
    foreach (BehaviorBase behavior in iBehaviors)
    {
      behaviors.Add(behavior);
    }

    oAgent = new UmbilicalAgent(new Point2d(initialUV.X, initialUV.Y), behaviors);
# ---------- end c_script_4 ----------
pt_9 = ConstructPoint(XCoordinate=remap_2.Mapped, YCoordinate=0, ZCoordinate=0)
c_script_5 = CSharpScript(
    iSurface=srfgrid,
    iAgents=c_script_4.oAgent,
    Reference=["C:\Users\Tobias Schwinn\AppData\Roaming\Grasshopper\Libraries\ICD.ABM.DigitalFutures22.Core.dll", "C:\Users\Tobias Schwinn\AppData\Roaming\Grasshopper\Libraries\ABxM.Core.dll"])  # -> out, oAgentSystem; inputs iSurface: Surface, iAgents: list
# ---------- c_script_5: C# ----------
    List<UmbilicalAgent> agents = new List<UmbilicalAgent>();
    foreach (UmbilicalAgent agent in iAgents)
      agents.Add(agent);

    UmbilicalAgentSystem agentSystem = new UmbilicalAgentSystem(agents);
    agentSystem.SystemSurface = iSurface;

    oAgentSystem = agentSystem;
# ---------- end c_script_5 ----------
image = ImageSampler(pt_9, Filter="Colour", Interpolate=False, Umax=1, Umin=0, Vmax=1, Vmin=0, Wrap=1)
trigger = Trigger(Interval=-1000, TimerInterval=1000, Target=solver)  # disabled
toggle_2 = BooleanToggle(True)
solver = StepByStepSolver(Reset=Button(), Execute=toggle_2, AgentSystems=c_script_5.oAgentSystem)  # -> DisplayGeometries, AllAgentSystems, IterationCount; disabled
solver_silent = SilentSolver(Execute=toggle_2, AgentSystems=c_script_5.oAgentSystem, MaxIterationCount="1000")  # -> DisplayGeometries, AllAgentSystems, IterationCount; disabled
solver_multi_threading_silent = SilentSolverMultiThreading(Execute=toggle_2, AgentSystems=c_script_5.oAgentSystem, MaxIterationCount="1000")  # -> DisplayGeometries, AllAgentSystems, IterationCount
panel_3 = Panel(solver_multi_threading_silent.IterationCount)
python = GhPythonScript(x=solver_multi_threading_silent.AllAgentSystems)  # -> out, a, b
# ---------- python: Python ----------
isFinished = []
pointsUV = []
points = []
if x is not None:
    for agent in x.Agents:
        isFinished.append(agent.isFinished)
        if agent.isFinished:
            pointsUV.append(agent.UV)

    
a = isFinished
b = pointsUV
# ---------- end python ----------
culln = CullNth(List=solver_multi_threading_silent.DisplayGeometries, CullFrequency=2)
conmesh = ConstructMesh(Vertices=demesh.Vertices, Faces=demesh.Faces, Colours=image)
panel_4 = Panel(python.a)
cullpt = CullDuplicates(Points=python.b, Tolerance=0.1, CullMode=3)  # -> Points, Indices, Valence
points_2 = PointList(Points=culln, Size=50)
evalsrf = EvaluateSurface(Surface=srfgrid, Point=cullpt.Points)  # -> Point, Normal, UDirection, VDirection, Frame
pdecon_3 = Deconstruct(Point=evalsrf.Point)  # -> XComponent, YComponent, ZComponent
panel_5 = Panel(pdecon_3.ZComponent)
smaller = SmallerThan(FirstNumber=pdecon_3.ZComponent, SecondNumber="20")  # -> SmallerThan, OrEqualTo
cull = CullPattern(List=evalsrf.Point, CullPattern=smaller.SmallerThan)
srf_cp_2 = SurfaceClosestPoint(Point=cull, Surface=planesrf)  # -> Point, UVPoint, Distance
evalsrf_2 = EvaluateSurface(Surface=srf_6, Point=srf_cp_2.UVPoint)  # -> Point, Normal, UDirection, VDirection, Frame
slider = Slider(5, range=0..10)
toggle_3 = BooleanToggle(True)
c_script_6 = CSharpScript(srf=srf_6, uv=srf_cp_2.UVPoint, accuracy=slider, max=toggle_3)  # -> out, pts; inputs srf: Surface, uv: Point3d, accuracy: Double, max: Boolean
# ---------- c_script_6: C# ----------
  
    //############### Modified from David Rutten & Sam Gregson's script ###############//


    //Limit the accuracy to the document tolerance.
    accuracy = System.Convert.ToDouble(Math.Max(accuracy, doc.ModelAbsoluteTolerance));

    //Declare our list of samples.
    List<Point3d> dir0 = SampleCurvature(srf, uv, accuracy, max, 0, 3);
    List<Point3d> dir1 = SampleCurvature(srf, uv, accuracy, max, Math.PI, 3);

    //Remove the first point in dir1 as it's a duplicate
    dir1.RemoveAt(0);
    dir1.Reverse();

    dir1.AddRange(dir0);
    pts = dir1;
# ---------- c_script_6: C# additional code ----------
  private List<Point3d> SampleCurvature(Surface srf, Point3d uv, double accuracy, bool max, double angle, int alg)
  {
    Point3d p = uv;
    Interval U = srf.Domain(0);
    Interval V = srf.Domain(1);

    List<Point3d> samples = new List<Point3d>();
    do
    {
      //Add the current point.
      samples.Add(srf.PointAt(p.X, p.Y));

      //####################################
      //##### Euler/Modified Euler/RK4 #####
      //####################################
      Vector3d dir = new Vector3d();

      switch (alg)
      {
        case 1:
          dir = Euler(srf, p, max, angle, accuracy, samples);
          break;
        case 2:
          dir = ModEuler(srf, p, max, angle, accuracy, samples);
          break;
        case 3:
          dir = RK4(srf, p, max, angle, accuracy, samples);
          break;

      }

      if (ReferenceEquals(dir, null))
      {
        break;
      }

      double s = 0;
      double t = 0;
      Point3d pt = samples[samples.Count - 1] + dir;
      if (!srf.ClosestPoint(pt, out s, out t))
      {
        break;
      }

      //##################
      //##### Checks #####
      //##################
      //Abort if we've added more than 10,000 samples.
      if (samples.Count > 9999)
      {
        break;
      }

      //Abort if we've wandered beyond the surface edge.
      if (!U.IncludesParameter(s, true))
      {
        break;
      }
      if (!V.IncludesParameter(t, true))
      {
        break;
      }

      //Abort if the new point is basically the same as the old point.
      if ((Math.Abs(p.X - s) < 1e-12) && (Math.Abs(p.Y - t) < 1e-12))
      {
        break;
      }

      p.X = s;
      p.Y = t;
    } while (true);

    return samples;
  }

  private Vector3d GetDir(Surface srf, Point3d p, bool max, double angle, double h, Vector3d PrevDir)
  {
    //Get the curvature at the current point.
    SurfaceCurvature crv = srf.CurvatureAt(p.X, p.Y);

    //Get the maximum principal direction.
    Vector3d dir = new Vector3d();
    if (crv.Kappa(0) > crv.Kappa(1))
    {
      if (max)
      {
        dir = crv.Direction(0);
      }
      else
      {
        dir = crv.Direction(1);
      }
    }
    else
    {
      if (max)
      {
        dir = crv.Direction(1);
      }
      else
      {
        dir = crv.Direction(0);
      }
    }

    dir.Rotate(angle, crv.Normal);

    if (!dir.IsValid)
    {
      return default(Vector3d);
    }
    if (!dir.Unitize())
    {
      return default(Vector3d);
    }

    //Scale the direction vector to match our accuracy.
    dir *= h;

    //Flip the direction 180 degrees if it seems to be going backwards
    if (!ReferenceEquals(PrevDir, null))
    {
      if (dir.IsParallelTo(PrevDir, 0.5 * Math.PI) < 0)
      {
        dir.Reverse();
      }
    }

    return dir;
  }

  private Vector3d Euler(Surface srf, Point3d p, bool max, double angle, double h, List<Point3d> samples)
  {
    int N = samples.Count;
    Vector3d PrevDir = new Vector3d();
    if (N > 1)
    {
      PrevDir = samples[N - 1] - samples[N - 2];
    }

    Vector3d dir = GetDir(srf, p, max, angle, h, PrevDir);
    if (ReferenceEquals(dir, null))
    {
      return default(Vector3d);
    }

    return dir;
  }

  private Vector3d ModEuler(Surface srf, Point3d p, bool max, double angle, double h, List<Point3d> samples)
  {
    int N = samples.Count;
    Vector3d PrevDir = new Vector3d();
    if (N > 1)
    {
      PrevDir = samples[N - 1] - samples[N - 2];
    }

    Vector3d dir1 = GetDir(srf, p, max, angle, h, PrevDir);
    if (ReferenceEquals(dir1, null))
    {
      return default(Vector3d);
    }

    //Move the last point in the list along the curvature direction.
    Point3d pt = samples[samples.Count - 1] + dir1;

    double s = 0;
    double t = 0;
    if (!srf.ClosestPoint(pt, out s, out t))
    {
      return default(Vector3d);
    }
    pt.X = s;
    pt.Y = t;

    Vector3d dir2 = GetDir(srf, pt, max, angle, h, dir1);
    if (ReferenceEquals(dir2, null))
    {
      return default(Vector3d);
    }

    Vector3d dir = (dir1 + dir2) * 0.5;
    return dir;
  }

  private Vector3d RK4(Surface srf, Point3d p, bool max, double angle, double h, List<Point3d>  samples)
  {
    int N = samples.Count;
    Vector3d PrevDir = new Vector3d();
    if (N > 1)
    {
      PrevDir = samples[N - 1] - samples[N - 2];
    }

    Vector3d K1 = GetDir(srf, p, max, angle, h, PrevDir);
    if (ReferenceEquals(K1, null))
    {
      return default(Vector3d);
    }

    //Move the last point in the list along the curvature direction.
    Point3d pt1 = samples[samples.Count - 1] + K1 * 0.5;

    double s = 0;
    double t = 0;
    if (!srf.ClosestPoint(pt1, out s, out t))
    {
      return default(Vector3d);
    }
    pt1.X = s;
    pt1.Y = t;

    Vector3d K2 = GetDir(srf, pt1, max, angle, h, K1);
    if (ReferenceEquals(K2, null))
    {
      return default(Vector3d);
    }

    Point3d pt2 = samples[samples.Count - 1] + K2 * 0.5;

    if (!srf.ClosestPoint(pt2, out s, out t))
    {
      return default(Vector3d);
    }
    pt2.X = s;
    pt2.Y = t;

    Vector3d K3 = GetDir(srf, pt2, max, angle, h, K1);
    if (ReferenceEquals(K3, null))
    {
      return default(Vector3d);
    }

    Point3d pt3 = samples[samples.Count - 1] + K3;

    if (!srf.ClosestPoint(pt3, out s, out t))
    {
      return default(Vector3d);
    }
    pt3.X = s;
    pt3.Y = t;

    Vector3d K4 = GetDir(srf, pt3, max, angle, h, K1);
    if (ReferenceEquals(K4, null))
    {
      return default(Vector3d);
    }

    Vector3d dir = (double) 1 / 6 * (K1 + 2 * K2 + 2 * K3 + K4);
    return dir;
  }
# ---------- end c_script_6 ----------
list_2 = ValueList({"Zero": 0, "One": 1, "Two": 2, "Three": 3}, selected="One")
list_3 = ValueList({"Zero": 0, "One": 1, "Two": 2, "Three": 3, "Four": 4}, selected="One")
pline = PolyLine(Vertices=c_script_6.pts, Closed=False)
item = ListItem(List=flatten(pline), Index=list_3, Wrap=True)
divide = DivideCurve(Curve=item, Count="10", Kinks=False)  # -> Points, Tangents, Parameters
cull_i = CullIndex(List=divide.Points, Indices=expr("0.5*x", "10"), Wrap=True)
srf_cp_3 = SurfaceClosestPoint(Point=cull_i, Surface=srf_6)  # -> Point, UVPoint, Distance
not = GateNot(A=toggle_3)
c_script_7 = CSharpScript(srf=srf_6, uv=srf_cp_3.UVPoint, accuracy=slider, max=not)  # -> out, pts; inputs srf: Surface, uv: Point3d, accuracy: Double, max: Boolean; same code as c_script_6
pline_2 = PolyLine(Vertices=c_script_7.pts, Closed=False)
