# Grasshopper definition ICD.ABM.DigitalFutures2022_Example.gh (Grasshopper 1.0.7)
# plug-ins: ICD.ABM.DigitalFutures22.Grasshopper, ICD.AbmFramework.Grasshopper, NGon

# ----
# © 2022 by ICD University of Stuttgart
# Reference Surface
number_slider = Slider(47, range=2..50)
# Agent Behaviors
srf = Surface(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)
popgeo = PopulateGeometry(Geometry=srf, Count=number_slider, Seed=1)

# ----
# Surface Attraction Behavior
weight = Slider(1, range=0..10)
bhvsrfattr = GhcBhvSrfAttr(Surface=srf, Weight=weight)

# ----
# Cohesion Behavior
distance = Slider(780, range=0..2000)
weight_2 = Slider(1, range=0..10)
ghcbhvcohesion = GhcBhvCohesion(Distance=distance, Weight=weight_2)

# ----
# Separation Behavior
power = Slider(0.5, range=0..10)
distance_2 = Slider(1100, range=0..2000)
weight_3 = Slider(1, range=0..10)
ghcseparation = GhcSeparation(Distance=distance_2, Power=power, AffectSelf=Toggle(True), Weight=weight_3)

# ----
# Define agents and their behaviors
dfagent = GhcDefineDFAgent(Positions=popgeo, Behaviors=[bhvsrfattr, ghcseparation, ghcbhvcohesion])

# ----
# Define single brep environment
number_slider_2 = Slider(100, range=0.1..1000)
ghcdefinesinglebrepenvironment = GhcDefineSingleBrepEnvironment(SingleBrep=srf, Spacing=number_slider_2)

# ----
# Define agent system
# change value to switch between connectivity
# diagram and dual mesh ((preliminary) projected
# component outlines)
number_slider_3 = Slider(1, range=0..2)
dfagentsystem = GhcDefineDFAgentSystem(CartesianEnvironment=ghcdefinesinglebrepenvironment, CartesianAgents=dfagent, ComputeDiagram=number_slider_3)

# ----
# Solver
button = Button()
toggle = BooleanToggle(False)
solver_silent = SilentSolver(Execute=toggle, MaxIterationCount="1000")  # -> DisplayGeometries, AllAgentSystems, IterationCount; disabled
solver = StepByStepSolver(Reset=button, Execute=toggle, AgentSystems=dfagentsystem)  # -> DisplayGeometries, AllAgentSystems, IterationCount
panel = Panel(solver.IterationCount)
pln = Plane(solver.DisplayGeometries)  # disabled

panel_2 = Panel("100")  # disabled

# ----
# test to possibly rebuild surface based on agent positions (if not pulled back completely to reference surface)
patch = Patch(Points=pln, Spans=20, Flexibility=1, Trim=True)  # disabled
swatch = ColourSwatch(SwatchColor=RGBA(94, 94, 94, 34))  # disabled
preview = CustomPreview(Geometry=patch, Material=swatch)  # disabled

item = ListItem(List=solver.DisplayGeometries, Index=0, Wrap=True)  # -> Item1, Item
msphere = MeshSphere(Base=pln, Radius=panel_2, UCount=10, VCount=20)  # disabled
preview_2 = CustomPreview(
    Geometry=msphere,
    Material={diffuse=RGB(221, 160, 221), emission=RGB(66, 48, 66), shine=0.5, specular=RGB(255, 255, 255), transparency=0})  # disabled
dual = Dual(Mesh=item.Item1, Type=0)
